# Grasshopper definition Nodes.gh (Grasshopper 1.0.8)
# plug-ins: Pancake

file_path = FilePath("C:\Users\X\OneDrive\文档\UCB\2026 Spring\02_Classes\CS285_Deep_Reinforcement_Learning\")
concatenate = Concatenate(FragmentA=file_path, FragmentB="BTG_{0}.stl")
geometry = Geometry([<mesh referenced from the Rhino model> x13])
list_length = ListLength(List=geometry)
filepath_series = FilepathSeries(
    PatternOfFilepath=concatenate,
    StartingIndex=1,
    QuantityOfFilenames=list_length,
    GenerateNext=False,
    Reset=False,
    LastSaveLocalization="neutral,N")  # -> Filepath, ListOfFilepath, CounterOfFirstFile
export_stl = ExportSTL(
    Mesh=geometry,
    Relocate=Toggle(True),
    SavePath=filepath_series.ListOfFilepath,
    SaveAsBinaryFile=True,
    SaveNow=Toggle(False),
    LastSaveLocalization="neutral,N")
panel = Panel(export_stl)
